# Dynamo graph Final Optimization and Wall Splits.dyn (Dynamo 2.13.1.3887)
# packages: GenerativeDesign 2.0.10.0

# group: Input
optimum_panel_size = DoubleSlider(250, range=150..300 step 25)  # graph input

# group: Selecting walls that include hosted elements such as walls or windows (panelized independently)
categories = Categories("OST_Doors")
all_elements_of_category = ElementsOfCategory(Category=categories)
getHost = FamilyInstance.GetHost(familyInstance=all_elements_of_category)
categories_2 = Categories("OST_Windows")
all_elements_of_category_2 = ElementsOfCategory(Category=categories_2)
getHost_2 = FamilyInstance.GetHost(familyInstance=all_elements_of_category_2)
list_create = List.Create(item0=getHost, item1=getHost_2)
flatten = List.Flatten(list=list_create)

# group: Location of Walls and Length
element_classes = ElementTypes("Wall")
all_elements_of_class = ElementsOfType(element_class=element_classes)
true_false_of_hosted_elements = Python(IN[0]=all_elements_of_class, IN[1]=flatten)  # CPython3
# ---------- true_false_of_hosted_elements.python (17 lines) ----------
# Load the Python Standard and DesignScript Libraries
import sys
import clr
clr.AddReference('ProtoGeometry')
from Autodesk.DesignScript.Geometry import *

all = IN[0]
host = IN[1]
boolmask = []

for wall in all:
    if wall in host:
        boolmask.append(False)
    else:
        boolmask.append(True)

OUT = boolmask
# ----------------------------------------
filterByBoolMask = List.FilterByBoolMask(list=all_elements_of_class, mask=true_false_of_hosted_elements)
getLocation = Element.GetLocation(element=filterByBoolMask.in)

# group: Different Wall Parameters Used
code_block = CodeBlock { "Length"; }
getParameterValueByName = Element.GetParameterValueByName(element=filterByBoolMask.in, parameterName=code_block)
code_block_2 = CodeBlock { "Unconnected Height"; }
getParameterValueByName_2 = Element.GetParameterValueByName(element=filterByBoolMask.in, parameterName=code_block_2)
code_block_3 = CodeBlock { "Base Constraint"; }
getParameterValueByName_3 = Element.GetParameterValueByName(element=filterByBoolMask.in, parameterName=code_block_3)
elementType = Element.ElementType(element=filterByBoolMask.in)

remember = Data.Remember(getParameterValueByName)

# group: Getting Remainder of Walls to be Split into new Frames
remainder_of_each_wall = remember % optimum_panel_size
rounding_by_5cm = CodeBlock(x=remainder_of_each_wall) { 5 * Math.Round(x / 5); }
adding_remainders_to_a = Python(IN[0]=rounding_by_5cm)  # "Adding Remainders to a Dictionary"; CPython3
# ---------- adding_remainders_to_a.python (19 lines) ----------
# Load the Python Standard and DesignScript Libraries
import sys
import clr
clr.AddReference('ProtoGeometry')
from Autodesk.DesignScript.Geometry import *

remaining = IN[0]
different = {}

for r in remaining:
    if r not in different:
        if r != 0:
            #Adding the list of different sizes left
            different[str(r)] = []
            different[str(r)].append(remaining.count(r))
        
       
       
OUT = different
# ----------------------------------------
keys = DesignScript.Builtin.Dictionary.Keys(dictionary=adding_remainders_to_a)
valueAtKey = DesignScript.Builtin.Dictionary.ValueAtKey(dictionary=adding_remainders_to_a, key=keys)
flatten_2 = List.Flatten(list=valueAtKey)

# group: Getting Number of Optimal Size Panels
sub = remember - remainder_of_each_wall
count_of_optimal_panel = sub / optimum_panel_size

# group: OUTPUTS
number_of_optimal_panel_sizes = Math.Sum(values=count_of_optimal_panel)
time_constraint = Python(IN[0]=optimum_panel_size, IN[1]=number_of_optimal_panel_sizes, IN[2]=keys, IN[3]=flatten_2)  # CPython3; graph output
# ---------- time_constraint.python (33 lines) ----------
# Load the Python Standard and DesignScript Libraries
import sys
import clr
import math
clr.AddReference('ProtoGeometry')
from Autodesk.DesignScript.Geometry import *

optimalsize = IN[0]
optimalcount = IN[1]
remainderlist = IN[2]
remaindercount = IN[3]

def timeEquation(x):
    return (0.0000127225*x*x-0.000672672*x+0.832541)

time = 0

#Time to do the optimal size panels
# 2 hours for setting up the machine
time = time + 2

# 1 hour for size 150 and 10% more for each size higher and 10% less for each size lower
time = time + timeEquation(optimalsize)*optimalcount

#Time for the remainder of the panels
# 2 hours for each set up of the machine
time = time + 2*len(remainderlist)

#Time for each manufacturing using the same definition
for x in range(len(remainderlist)):
    time = time + timeEquation(float(remainderlist[x]))*remaindercount[x]

OUT = time
# ----------------------------------------
number_of_additional_panel_sizes = Math.Sum(values=flatten_2)
total_number_of_panels_produced = number_of_optimal_panel_sizes + number_of_additional_panel_sizes  # graph output
additional_panel_sizes_created = List.Count(list=flatten_2)  # graph output

# group: Start and End Points of the Walls
startPoint = Curve.StartPoint(curve=getLocation)
X = Point.X(point=startPoint)
endPoint = Curve.EndPoint(curve=getLocation)
X_2 = Point.X(point=endPoint)
Y = Point.Y(point=startPoint)
Y_2 = Point.Y(point=endPoint)
Z = Point.Z(point=startPoint)

# group: Building New Points for the X and Y's of each new point that is splitting the walls
sub_2 = X - X_2
round = Math.Round(number=sub_2)
sub_3 = Y - Y_2
round_2 = Math.Round(number=sub_3)
list_create_2 = List.Create(item0=round, item1=round_2)
transpose = List.Transpose(lists=list_create_2)
getting_split_points = Python(IN[0]=transpose, IN[1]=optimum_panel_size, IN[2]=count_of_optimal_panel, IN[3]=X, IN[4]=Y, IN[5]=X_2, IN[6]=Y_2)  # CPython3
# ---------- getting_split_points.python (44 lines) ----------
# Load the Python Standard and DesignScript Libraries
import sys
import clr
import math
clr.AddReference('ProtoGeometry')
from Autodesk.DesignScript.Geometry import *

xy = IN[0]
opt = IN[1]
splits = IN[2]
xstart = IN[3]
ystart = IN[4]
xend = IN[5]
yend = IN[6]
listOfPoints = []

#assuming points are only in the x or y direciton
for loc in range(len(xy)):
    #setting new points to make list and add Start Point
    xpoints = [xstart[loc]]
    ypoints = [ystart[loc]]
    #need local variables that can change between each split
    xnew = xstart
    ynew = ystart
    
    for split in range(int(splits[loc])):
        newlength = math.sqrt(math.pow(xend[loc]-xstart[loc],2) + math.pow(yend[loc]-ystart[loc],2))
        newratio = newlength / opt       
        
        xnew[loc] = xnew[loc] + (xend[loc]-xstart[loc])/newratio
        ynew[loc] = ynew[loc] + (yend[loc]-ystart[loc])/newratio
        
        xpoints.append(xnew[loc])
        ypoints.append(ynew[loc])
        
    if xpoints[-1] == xend[loc] and ypoints[-1] == yend[loc]:
        pass
    else:
        xpoints.append(xend[loc])
        ypoints.append(yend[loc])
    
    listOfPoints.append([xpoints, ypoints])

OUT = listOfPoints   
# ----------------------------------------
transpose_2 = List.Transpose(lists=getting_split_points@L3)

# group: Getting Lines from Split Points
start_and_end_points = Python(IN[0]=transpose_2, IN[1]=Z)  # CPython3
# ---------- start_and_end_points.python (18 lines) ----------
# Load the Python Standard and DesignScript Libraries
import sys
import clr
clr.AddReference('ProtoGeometry')
from Autodesk.DesignScript.Geometry import *

walls = IN[0]
zs = IN[1]
p1 = []
p2 = []

for wall in range(len(walls)):
    for point in range(len(walls[wall])-1):
        p1.append(Point.ByCoordinates(walls[wall][point][0],walls[wall][point][1],zs[wall]))
        p2.append(Point.ByCoordinates(walls[wall][point+1][0],walls[wall][point+1][1],zs[wall]))
        
        
OUT = p1, p2
# ----------------------------------------
firstItem = List.FirstItem(list=start_and_end_points)
lastItem = List.LastItem(list=start_and_end_points)
byStartPointEndPoint = Line.ByStartPointEndPoint(startPoint=firstItem, endPoint=lastItem)

# group: Creating New Walls
height_for_each_segment = Python(IN[0]=count_of_optimal_panel, IN[1]=getParameterValueByName_2)  # CPython3
# ---------- height_for_each_segment.python (15 lines) ----------
# Load the Python Standard and DesignScript Libraries
import sys
import clr
clr.AddReference('ProtoGeometry')
from Autodesk.DesignScript.Geometry import *

splits = IN[0]
heights = IN[1]
listOfhs = []

for ea in range(len(heights)):
    #split the z's in the same way, just adding the 2 for the start and end point as well
    listOfhs = listOfhs + [heights[ea]] * (int(splits[ea])+1)

OUT = listOfhs   
# ----------------------------------------
base_constraints_for_each = Python(IN[0]=count_of_optimal_panel, IN[1]=getParameterValueByName_3)  # "Base Constraints for Each Segment"; CPython3
# ---------- base_constraints_for_each.python (15 lines) ----------
# Load the Python Standard and DesignScript Libraries
import sys
import clr
clr.AddReference('ProtoGeometry')
from Autodesk.DesignScript.Geometry import *

splits = IN[0]
levels = IN[1]
listOfLs = []

for ea in range(len(levels)):
    #split the z's in the same way, just adding the 2 for the start and end point as well
    listOfLs = listOfLs + ([levels[ea]] * int(splits[ea]+1))

OUT = listOfLs
# ----------------------------------------
walltype_for_each_segment = Python(IN[0]=count_of_optimal_panel, IN[1]=elementType)  # CPython3
# ---------- walltype_for_each_segment.python (15 lines) ----------
# Load the Python Standard and DesignScript Libraries
import sys
import clr
clr.AddReference('ProtoGeometry')
from Autodesk.DesignScript.Geometry import *

splits = IN[0]
types = IN[1]
listOfts = []

for ea in range(len(types)):
    #split the z's in the same way, just adding the 2 for the start and end point as well
    listOfts = listOfts + [types[ea]] * (int(splits[ea])+1)

OUT = listOfts
# ----------------------------------------
byCurveAndHeight = Wall.ByCurveAndHeight(curve=byStartPointEndPoint, height=height_for_each_segment, level=base_constraints_for_each, wallType=walltype_for_each_segment)

# group: Delete Old Walls
code_block_4 = CodeBlock(x=height_for_each_segment) { x>0; }
filterByBoolMask_2 = List.FilterByBoolMask(list=filterByBoolMask.in, mask=code_block_4)
delete = Element.Delete(element=filterByBoolMask_2.in)
