# Dynamo graph QTO.dyn (Dynamo 2.13.1.3887)

# group: Writing Header
file_path = Filename(".\qto.xlsx")
code_block = CodeBlock { "Sheet1"; 0; true; }
code_block_2 = CodeBlock { [["PanelName","Count of Panels","FrameNumber", "Count of Frames in Panels"]]; }
exportToExcel = Data.ExportToExcel(filePath=file_path, sheetName=code_block.out0, startRow=code_block.out1, startColumn=code_block.out1, data=code_block_2, overWrite=code_block.out2)

# group: Making sure new sheet is created from header
isEmpty = List.IsEmpty(list=exportToExcel)
code_block_3 = CodeBlock { "none"; }
categories = Categories("OST_StructuralFraming")
all_elements_of_category = ElementsOfCategory(Category=categories)
if_ = RefactoredIf(test=isEmpty, true=code_block_3, false=all_elements_of_category)

# group: Parameter Values
code_block_4 = CodeBlock { "HostWall"; "PanelName"; "FrameNumber"; }
getParameterValueByName = Element.GetParameterValueByName(element=if_, parameterName=code_block_4.out0)
getParameterValueByName_2 = Element.GetParameterValueByName(element=if_, parameterName=code_block_4.out1)
getParameterValueByName_3 = Element.GetParameterValueByName(element=if_, parameterName=code_block_4.out2)

# group: Panel Types and the Number of Frames in Them
panel_types_and_the_number_of = Python(IN[0]=getParameterValueByName, IN[1]=getParameterValueByName_2, IN[2]=getParameterValueByName_3)  # "Panel Types and the Number of Frames in Them"; CPython3
# ---------- panel_types_and_the_number_of.python (26 lines) ----------
# Load the Python Standard and DesignScript Libraries
import sys
import clr
clr.AddReference('ProtoGeometry')
from Autodesk.DesignScript.Geometry import *

HostWall = IN[0]
PanelName = IN[1]
FrameNumber = IN[2]

countpanels = {}
dicpanels = {}

for panel in PanelName:
    if panel not in dicpanels:
        countpanels[panel] = PanelName.count(panel)
        dicframes = {}
        countframes = 0
        for frame in range(len(PanelName)):
            if PanelName[frame] == panel:
                dicframes[FrameNumber[frame]] = dicframes.setdefault(FrameNumber[frame],0) + 1

        dicpanels[panel] = dicframes


OUT = countpanels, dicpanels   
# ----------------------------------------

# group: Frame Dictionary Creation
lastItem = List.LastItem(list=panel_types_and_the_number_of)
values = DesignScript.Builtin.Dictionary.Values(dictionary=lastItem)
keys = DesignScript.Builtin.Dictionary.Keys(dictionary=values)
flatten = List.Flatten(list=keys)
values_2 = DesignScript.Builtin.Dictionary.Values(dictionary=values)
flatten_2 = List.Flatten(list=values_2)
list_create = List.Create(item0=flatten, item1=flatten_2)
transpose = List.Transpose(lists=list_create)

# group: Panel Dictionary Creation
firstItem = List.FirstItem(list=panel_types_and_the_number_of)
keys_2 = DesignScript.Builtin.Dictionary.Keys(dictionary=firstItem)
values_3 = DesignScript.Builtin.Dictionary.Values(dictionary=firstItem)
to_add_empty_slots_in_the_excel = Python(IN[0]=values, IN[1]=keys_2, IN[2]=values_3)  # "To add empty slots in the excel sheet"; CPython3
# ---------- to_add_empty_slots_in_the_excel.python (22 lines) ----------
# Load the Python Standard and DesignScript Libraries
import sys
import clr
clr.AddReference('ProtoGeometry')
from Autodesk.DesignScript.Geometry import *

framedic = IN[0]
count = []

for frame in framedic:
    count.append(len(frame.keys()))
    
keys = IN[1]
values = IN[2]
nkeys = []
nvalues = []

for ea in range(len(keys)):
    nkeys.append([keys[ea]] + [" "] * (int(count[ea])-1))
    nvalues.append([values[ea]] + [" "] * (int(count[ea])-1))
    
OUT = nkeys, nvalues
# ----------------------------------------
firstItem_2 = List.FirstItem(list=to_add_empty_slots_in_the_excel)
flatten_3 = List.Flatten(list=firstItem_2)
lastItem_2 = List.LastItem(list=to_add_empty_slots_in_the_excel)
flatten_4 = List.Flatten(list=lastItem_2)
list_create_2 = List.Create(item0=flatten_3, item1=flatten_4)
transpose_2 = List.Transpose(lists=list_create_2)

# group: To Write The Panels and their Count
file_path_2 = Filename(".\qto.xlsx")
code_block_5 = CodeBlock { "Sheet1"; 0; 1; }
exportToExcel_2 = Data.ExportToExcel(filePath=file_path_2, sheetName=code_block_5.out0, startRow=code_block_5.out2, startColumn=code_block_5.out1, data=transpose_2)

# group: To Write the Frames and their Count
file_path_3 = Filename(".\qto.xlsx")
code_block_6 = CodeBlock { "Sheet1"; 2; 1; }
exportToExcel_3 = Data.ExportToExcel(filePath=file_path_3, sheetName=code_block_6.out0, startRow=code_block_6.out2, startColumn=code_block_6.out1, data=transpose)
