# Dynamo graph plumbing system.dyn (Dynamo 2.13.1.3887)
# packages: MEPover 2022.10.30, Clockwork for Dynamo 2.x 2.4.0, Crumple 2022.5.27, GenerativeDesign 2.0.10.0, archi-lab.net 2023.213.1722

# group: Selecting All Elements in View
all_elements_in_active_view = ElementsInView()
getCategory = Element.GetCategory(element=all_elements_in_active_view)

# group: Selecting Walls and Importing Geometry
string_from_object = FromObject(object=getCategory)
code_block = CodeBlock { "Walls"; }
eq = string_from_object == code_block
filterByBoolMask = List.FilterByBoolMask(list=all_elements_in_active_view, mask=eq)
geometry = Element.Geometry(element=filterByBoolMask.in)
id = Element.Id(element=filterByBoolMask.in)

# group: Selecting Plumbing Fixtures and Importing Geometry
string_from_object_2 = FromObject(object=getCategory)
code_block_2 = CodeBlock { "Plumbing Fixtures"; }
eq_2 = string_from_object_2 == code_block_2
filterByBoolMask_2 = List.FilterByBoolMask(list=all_elements_in_active_view, mask=eq_2)
geometry_2 = Element.Geometry(element=filterByBoolMask_2.in)
host = Custom[Element.Host+](element=filterByBoolMask_2.in)  # package Clockwork for Dynamo 2.x; Gets an element's host. Unlike the OOTB node FamilyInstance.GetHost it not only works for family instances but also for elements like wall sweeps, foundations, railings, builing pads and topo subregions.

# group: Selecting Connectors from Plumbing Fixtures and Getting their Location/Direction
connectors = Custom[Element.Connectors](element=filterByBoolMask_2.in)  # package MEPover; Returns every connector on an element (also return connectors of a System)
location = Custom[Connector.Location](connector=connectors)  # package MEPover; Returns the location of a connector
direction = Custom[Connector.Direction](connector=connectors)  # package MEPover; Returns the direction of the CoordinateSystem of the Connector
asPoint = Vector.AsPoint(vector=direction)
Z = Point.Z(point=asPoint)
code_block_3 = CodeBlock { -1; }
eq_3 = Z == code_block_3
filterByBoolMask_3 = List.FilterByBoolMask(list=connectors, mask=eq_3)

# group: Pipe Properties
element_classes = ElementTypes("PipeType")
all_elements_of_class = ElementsOfType(element_class=element_classes)
code_block_4 = CodeBlock { 15; 0; 15; 1; }
getItemAtIndex = List.GetItemAtIndex(list=all_elements_of_class, index=code_block_4.out1)
gate = Data.Gate(false, all_elements_of_class)
getItemAtIndex_2 = List.GetItemAtIndex(list=gate, index=code_block_4.out1)
element_classes_2 = ElementTypes("PipingSystemType")
all_elements_of_class_2 = ElementsOfType(element_class=element_classes_2)
gate_2 = Data.Gate(false, all_elements_of_class_2)
getItemAtIndex_3 = List.GetItemAtIndex(list=gate_2, index=code_block_4.out3)
levels = Levels("00-GF-FFL")
getItemAtIndex_4 = List.GetItemAtIndex(list=all_elements_of_class_2, index=code_block_4.out3)

# group: Drainage Pipe
location_2 = Custom[Connector.Location](connector=filterByBoolMask_3.in)
direction_2 = Custom[Connector.Direction](connector=filterByBoolMask_3.in)
Z_2 = Point.Z(point=location_2)
code_block_5 = CodeBlock(z=Z_2) { length = 0.6*z; }
byStartPointDirectionLength = Line.ByStartPointDirectionLength(startPoint=location_2, direction=direction_2, length=code_block_5)

# group: Input
integer_slider = IntegerSlider(109, range=0..300 step 1)  # graph input

# group: Structural Framing
light_steel_frame_element = CodeBlock { "Structural Framing"; }  # "Light Steel Frame Element Category"
string_from_object_3 = FromObject(object=getCategory)
eq_4 = light_steel_frame_element == string_from_object_3
filterByBoolMask_4 = List.FilterByBoolMask(list=all_elements_in_active_view, mask=eq_4)
geometry_3 = Element.Geometry(element=filterByBoolMask_4.in)
remember = Data.Remember(geometry_3)

select_model_element = DSModelElementSelection()  # 1 picked in the model; frozen
select_model_element_2 = DSModelElementSelection()  # 1 picked in the model

# group: FIRST SET OF ELBOWS
list_create = List.Create(item0=select_model_element, item1=select_model_element_2)
byMEPCurves = Custom[Elbow.ByMEPCurves](MEPCurves=list_create)  # package MEPover; Takes in a list of MEPCurves (pipe, duct, cable tray, conduit) and will attempt to create elbows where possible. A margin can be entered for max distance between connectors

# group: Selecting the Walls that have the plumbing fixtures hosted on them and getting their width
id_2 = Element.Id(element=host)
eq_5 = id_2 == id  # lacing=CrossProduct
transpose = List.Transpose(lists=eq_5)
anyTrue = List.AnyTrue(list=transpose@L2)
filterByBoolMask_5 = List.FilterByBoolMask(list=filterByBoolMask.in, mask=anyTrue)

# group: Getting width of the wall
code_block_6 = CodeBlock { 20; }
wallType = archilab.Revit.Elements.Walls.WallType(wall=filterByBoolMask_5.in)
width = WallType.Width(wallType=wallType)
remember_2 = Data.Remember(width)

# group: Drawing 1st Water and Drainage Connection as Line
location_3 = Custom[Connector.Location](connector=filterByBoolMask_3.out)
remember_3 = Data.Remember(location_3)
direction_3 = Custom[Connector.Direction](connector=filterByBoolMask_3.out)
remember_4 = Data.Remember(direction_3)
code_block_7 = CodeBlock(x=code_block_6) { lineLength = x / 2; }
byStartPointDirectionLength_2 = Line.ByStartPointDirectionLength(startPoint=remember_3, direction=remember_4, length=code_block_7, lacing=Longest)
water_pipe_1 = Custom[Water Pipe 1](Lines=byStartPointDirectionLength_2, PipeType=getItemAtIndex_2, SystemType=getItemAtIndex_4, level=levels, Diameter=code_block_4.out2, lacing=Longest)  # package MEPover; Creates a pipe by Line, PipeType, SystemType, Level and Diameter
geometry_4 = Element.Geometry(element=water_pipe_1)

# group: water: getting new point 2 and drawings line 2
endPoint = Curve.EndPoint(curve=byStartPointDirectionLength_2)
code_block_8 = CodeBlock { 0; 1; 5; }
getItemAtIndex_5 = List.GetItemAtIndex(list=endPoint, index=code_block_8.out0)
X = Point.X(point=endPoint)
Y = Point.Y(point=endPoint)
Z_3 = Point.Z(point=endPoint)
code_block_9 = CodeBlock { 300; }
maximumItem = List.MaximumItem(list=Z_3)
code_block_10 = CodeBlock(height=code_block_9, z=maximumItem) { maxValue = height - z; }
python_script = Python(IN[0]=integer_slider, IN[1]=code_block_8.out0, IN[2]=code_block_10)  # IronPython2
# ---------- python_script.python (21 lines) ----------
# Load the Python Standard and DesignScript Libraries
import sys
import clr
clr.AddReference('ProtoGeometry')
from Autodesk.DesignScript.Geometry import *

# The inputs to this node will be stored as a list in the IN variables.
dataEnteringNode = IN

# Place your code below this line
num = IN[0]
min_bound = IN[1]
max_bound = IN[2]    

if num < min_bound: 
   num = min_bound
if num > max_bound: 
   num = max_bound
   
# Assign your output to the OUT variable.
OUT = num
# ----------------------------------------
code_block_11 = CodeBlock(zEndPoint=Z_3, y=python_script) { z = zEndPoint + y; }
byCoordinates = Point.ByCoordinates(x=X, y=Y, z=code_block_11)
getItemAtIndex_6 = List.GetItemAtIndex(list=byCoordinates, index=code_block_8.out0)
byStartPointEndPoint = Line.ByStartPointEndPoint(startPoint=getItemAtIndex_5, endPoint=getItemAtIndex_6)
water_pipe_2 = Custom[Water Pipe 2](Lines=byStartPointEndPoint, PipeType=getItemAtIndex_2, SystemType=getItemAtIndex_3, level=levels, Diameter=code_block_4.out2, lacing=Longest)  # package MEPover; Creates a pipe by Line, PipeType, SystemType, Level and Diameter
geometry_5 = Element.Geometry(element=water_pipe_2)
getItemAtIndex_7 = List.GetItemAtIndex(list=byCoordinates, index=code_block_8.out1)
X_2 = Point.X(point=getItemAtIndex_7)
Y_2 = Point.Y(point=getItemAtIndex_7)
getItemAtIndex_8 = List.GetItemAtIndex(list=endPoint, index=code_block_8.out1)
Z_4 = Point.Z(point=getItemAtIndex_6)
sub = Z_4 - code_block_8.out2
byCoordinates_2 = Point.ByCoordinates(x=X_2, y=Y_2, z=sub)
byStartPointEndPoint_2 = Line.ByStartPointEndPoint(startPoint=getItemAtIndex_8, endPoint=byCoordinates_2)
water_pipe_2_2 = Custom[Water Pipe 2](Lines=byStartPointEndPoint_2, PipeType=getItemAtIndex_2, SystemType=getItemAtIndex_3, level=levels, Diameter=code_block_4.out2, lacing=Longest)

# group: Drainage pipe 2
endPoint_2 = Curve.EndPoint(curve=byStartPointDirectionLength)
X_3 = Point.X(point=endPoint)
Y_3 = Point.Y(point=endPoint)
Z_5 = Point.Z(point=endPoint_2)
byCoordinates_3 = Point.ByCoordinates(x=X_3, y=Y_3, z=Z_5)
byStartPointEndPoint_3 = Line.ByStartPointEndPoint(startPoint=endPoint_2, endPoint=byCoordinates_3)

# group: Transforming Pipes into lines
drainage_pipe_2 = Custom[Drainage Pipe 2](Lines=byStartPointEndPoint_3, PipeType=getItemAtIndex_2, SystemType=getItemAtIndex_3, level=levels, Diameter=code_block_4.out0, lacing=Longest)  # package MEPover; Creates a pipe by Line, PipeType, SystemType, Level and Diameter
geometry_6 = Element.Geometry(element=drainage_pipe_2)
geometry_7 = Element.Geometry()  # unwired: element
drainage_pipe_1 = Custom[Drainage Pipe 1](Lines=byStartPointDirectionLength, PipeType=getItemAtIndex_2, SystemType=getItemAtIndex_3, level=levels, Diameter=code_block_4.out0, lacing=Longest)  # package MEPover; Creates a pipe by Line, PipeType, SystemType, Level and Diameter
geometry_8 = Element.Geometry(element=drainage_pipe_1)

# group: water: getting point 3 and line 3
endPoint_3 = Curve.EndPoint(curve=byStartPointEndPoint)
Z_6 = Point.Z(point=endPoint_3)
byCoordinates_4 = Point.ByCoordinates(x=X_2, y=Y_2, z=Z_6)
byStartPointEndPoint_4 = Line.ByStartPointEndPoint(startPoint=endPoint_3, endPoint=byCoordinates_4, lacing=Longest)
water_pipe_3 = Custom[Water Pipe 3](Lines=byStartPointEndPoint_4, PipeType=getItemAtIndex_2, SystemType=getItemAtIndex_3, level=levels, Diameter=code_block_4.out0, lacing=Longest)  # package MEPover; Creates a pipe by Line, PipeType, SystemType, Level and Diameter

# group: COUNTING INTERSECTIONS
geometry_9 = Element.Geometry(element=water_pipe_3)
doesIntersect = Geometry.DoesIntersect(geometry=remember, other=byStartPointEndPoint_4, lacing=Longest)
flatten = List.Flatten(list=doesIntersect)
countTrue = List.CountTrue(list=flatten)  # graph output

# group: FIRST SET OF ELBOWS
list_create_2 = List.Create(item0=water_pipe_2, item1=water_pipe_2_2)  # frozen
list_create_3 = List.Create(item0=water_pipe_1, item1=list_create_2)
flatten_2 = List.Flatten(list=list_create_3)
byMEPCurves_2 = Custom[Elbow.ByMEPCurves](MEPCurves=flatten_2)

# group: FIRST SET OF ELBOWS
list_create_4 = List.Create(item0=drainage_pipe_1, item1=drainage_pipe_2)  # frozen
flow_waitfor = Custom[© Flow.WaitFor](data=list_create_4, waitFor=countTrue)  # package Crumple; Tells the first input to wait for the second input to arrive, then passes on the first input. Really useful for scripts which have branching paths that rely on their outputs to carry each other forward. Quite a few custom packages have a 'passthrough' or 'waitfor' node. I use these all the time, so find it useful to have them contained in this package also.
flatten_3 = List.Flatten(list=flow_waitfor)
code_block_12 = CodeBlock { 0; 1; 2; 3; }
getItemAtIndex_9 = List.GetItemAtIndex(list=flatten_3, index=code_block_12.out0)
getItemAtIndex_10 = List.GetItemAtIndex(list=flatten_3, index=code_block_12.out2)
list_create_5 = List.Create(item0=getItemAtIndex_9, item1=getItemAtIndex_10)
byMEPCurves_3 = Custom[Elbow.ByMEPCurves](MEPCurves=list_create_5)
getItemAtIndex_11 = List.GetItemAtIndex(list=flatten_3, index=code_block_12.out1)
getItemAtIndex_12 = List.GetItemAtIndex(list=flatten_3, index=code_block_12.out3)
list_create_6 = List.Create(item0=getItemAtIndex_11, item1=getItemAtIndex_12)
byMEPCurves_4 = Custom[Elbow.ByMEPCurves](MEPCurves=list_create_6)

# group: GETTING SUM OF LENGTHS OF PIPES
code_block_13 = CodeBlock { 0; }
getItemAtIndex_13 = List.GetItemAtIndex(list=byStartPointDirectionLength_2, index=code_block_13)
list_create_7 = List.Create(item0=byStartPointEndPoint_4, item1=byStartPointEndPoint, item2=getItemAtIndex_13)
length = Curve.Length(curve=list_create_7)
flatten_4 = List.Flatten(list=length)
sum = Math.Sum(values=flatten_4)  # graph output

by2MEPCurves = Custom[Tee.By2MEPCurves](Main_MEPCurve=select_model_element, Branch_MEPCurve=select_model_element_2)  # package MEPover; Creates a tee by a main curve and a branch MEP curve (duct, pipe, conduit, cable tray). Only works with perpendicular brand curves
